# Dynamo graph Get_Coordinates_V2.dyn (Dynamo 1.3.3.4651)

# group: Directorio archivos E&N
# note: Aquí la ruta donde tiene los archivos de E&N
directory_path = Directory("D:\JAVIER\Calidad\para checkear\S")
fromPath = DirectoryObject(directory_path)  # "Directory.FromPath"
contents = Directory.Contents(fromPath)
fileName = FilePath.FileName(contents)

# group: Colección de N/S; E/W; elevación y ángulo
flatten = Flatten(contents)
PBP_SP_Collector = Custom[PBP_SP_Collector]()  # Collects information (N/S, E/W, Elevation and angle) from PBP and SP; unwired: arg0
map = List.Map(list=flatten, f_x=PBP_SP_Collector)
pbp_y_sp_coordenadas_organizadas = Python(IN[0]=map, IN[1]=fileName)
# ---------- pbp_y_sp_coordenadas_organizadas.python (42 lines) ----------
import clr

clr.AddReference('RevitAPI')
from Autodesk.Revit.DB import *
from Autodesk.Revit.DB.Structure import *


clr.AddReference('RevitAPIUI')
from Autodesk.Revit.UI import TaskDialog

clr.AddReference('RevitNodes')
import Revit
clr.ImportExtensions(Revit.GeometryConversion)
clr.ImportExtensions(Revit.Elements)

clr.AddReference('RevitServices')
import RevitServices
from RevitServices.Persistence import DocumentManager
from RevitServices.Transactions import TransactionManager

doc = DocumentManager.Instance.CurrentDBDocument
uidoc=DocumentManager.Instance.CurrentUIApplication.ActiveUIDocument
app = uidoc.Application

datos = IN[0]
fileNames = IN[1]

fbsCode = [x[3:7] for x in fileNames]
fbsCode2 = [x[32:] for x in fileNames]
fbsCode3 = [x.replace('_E&N', '') for x in fbsCode2]
mix = zip(fbsCode, fbsCode3)
fbsCode4 = [(x[0] + x[1]) for x in mix]

l0 = list()

for a in datos:
    flatList = [item for sublist in a for item in sublist]
    l0.append(flatList)

for b in range(len(l0)):
    l0[b].insert(0,fbsCode4[b])
OUT = l0
# ----------------------------------------

# group: Exportación a Excel
# note: Presione el botón Run, verifique si es necesario la ruta donde guardará el archivo en Excel
file_path = Filename("WP 3_0\2020-06-24\NL_WP 3.0_S Models_2020-06-24.xls")
code_block = CodeBlock { "Coordenadas"; 0; }
writeToFile = Excel.WriteToFile(filePath=file_path, sheetName=code_block.out0, startRow=code_block.out1, startCol=code_block.out1, data=pbp_y_sp_coordenadas_organizadas)
